# Grasshopper definition RetrieveStructuralBeams.gh (Grasshopper 1.0.7)
# plug-ins: Speckle 2, Rhino.Inside for Autodesk Revit

built_in_categories = BuiltInCategories("autodesk.revit.category.family:structuralFraming-1.0.0", LayoutLevel=2, SearchPattern="Structural Frame")
receive = Receive(
    Stream="https://speckle.xyz/streams/d44d853c60/commits/da109b4c5c",
    AutoReceive=False,
    CurrentComponentState="up_to_date",
    ExpandOutput=True,
    LastInfoMessage="Carlos Villagrasa Silanes @ 2022-05-13T10:55:27.711Z: testing custom Speckle Object (id:da109b4c5c)",
    ReceiveOnOpen=False,
    ReceivedCommitId="da109b4c5c",
    StreamWrapper="https://speckle.xyz/streams/d44d853c60/commits/da109b4c5c",
    selectedKitName="Objects")  # -> Info, Request, Units, User_id
category_filter = CategoryFilter(Categories=built_in_categories, Inverted=False)
c_script = CSharpScript(request=receive.Request)  # -> out, unit, field, answer, number, element, success, direction, element_name
# ---------- c_script: C# ----------
    Dictionary<string, object> openWith =
      new Dictionary<string, object>();

    Dictionary<string, object> dict = request as Dictionary<string, object>;

    unit = dict["unit"];
    field = dict["field"];
    answer = dict["answer"];
    number = dict["number"];
    element = dict["element"];
    success = dict["success"];
    direction = dict["direction"];
    element_name = dict["element_name"];
    //A = request as System.Collections.Generic.HashSet<string, Object>;
# ---------- end c_script ----------
c_script_2 = CSharpScript(x=receive.Request)  # -> out, A
# ---------- c_script_2: C# ----------
    A = x;
# ---------- end c_script_2 ----------
panel = Panel(c_script_2.A)
query_elements = QueryElements(Filter=category_filter, Limit="2000")  # -> Elements, Count
geometry = Geometry(query_elements.Elements)  # disabled
c__rir = CSharp_RIR(
    element_name="B18",
    Reference=["C:\JimPlayGround\Speckle_Hackthon_dup\returnName\externalReferences\2022\RevitAPI.dll", "C:\JimPlayGround\Speckle_Hackthon_dup\returnName\externalReferences\2022\RevitAPIUI.dll", "C:\ProgramData\Autodesk\Revit\Addins\2022\RhinoInside.Revit\RhinoInside.Revit.dll"])  # -> out, RevitElements; inputs element_name: String
# ---------- c__rir: C# usings ----------
using DB = Autodesk.Revit.DB;
using UI = Autodesk.Revit.UI;

using RhinoInside.Revit;
using RhinoInside.Revit.Convert.Geometry;
using System.Linq;
# ---------- c__rir: C# ----------
    string element_Name;
    element_Name = element_name;

    var Elements = new DB.FilteredElementCollector(Revit.ActiveDBDocument).
      OfCategory(DB.BuiltInCategory.OST_StructuralFraming).
      WhereElementIsNotElementType().
      ToElements().
      Where(x => {
      DB.ElementId typeId = x.GetTypeId();
      return Revit.ActiveDBDocument.GetElement(typeId).get_Parameter(DB.BuiltInParameter.WINDOW_TYPE_ID).AsString() == element_Name;
      });

    RevitElements = Elements;
# ---------- end c__rir ----------
c__rir_2 = CSharp_RIR(
    rvtElements=query_elements.Elements,
    element_name="B18",
    Reference=["C:\JimPlayGround\Speckle_Hackthon_dup\returnName\externalReferences\2022\RevitAPI.dll", "C:\JimPlayGround\Speckle_Hackthon_dup\returnName\externalReferences\2022\RevitAPIUI.dll", "C:\ProgramData\Autodesk\Revit\Addins\2022\RhinoInside.Revit\RhinoInside.Revit.dll"])  # -> out, RevitElements; inputs element_name: String; same code as c__rir
element_geometry = ElementGeometry(Elements=c__rir.RevitElements)
c__rir_3 = CSharp_RIR(
    RevitElements=c__rir.RevitElements,
    direction=c_script.direction,
    number=Slider(1, range=0..1),
    Reference=["C:\JimPlayGround\Speckle_Hackthon_dup\returnName\externalReferences\2022\RevitAPI.dll", "C:\JimPlayGround\Speckle_Hackthon_dup\returnName\externalReferences\2022\RevitAPIUI.dll", "C:\ProgramData\Autodesk\Revit\Addins\2022\RhinoInside.Revit\RhinoInside.Revit.dll"])  # -> out, A; inputs RevitElements: list, direction: String, number: Double
# ---------- c__rir_3: C# usings ----------
using DB = Autodesk.Revit.DB;
using UI = Autodesk.Revit.UI;

using RhinoInside.Revit;
using RhinoInside.Revit.Convert.Geometry;
# ---------- c__rir_3: C# ----------
    List<DB.Element> revitElements = RevitElements.ConvertAll(i => i as DB.Element);
    try{
      using(var txx = new DB.Transaction(Revit.ActiveDBDocument, Component.NickName))
      {

        txx.Start();
        if(direction == "right"){
          MoveRight(revitElements, number);
        }
        else if(direction == "left"){
          MoveLeft(revitElements, number);
        }
        else if(direction == "up"){
          MoveUp(revitElements, number);
        }
        else if(direction == "down"){
          MoveDown(revitElements, number);
        }
        txx.Commit();
      }
    }
    catch{
    }

    A = revitElements;
# ---------- c__rir_3: C# additional code ----------
  public void MoveRight(List<DB.Element> Elements, double Number)
  {
    DB.XYZ translation = new DB.XYZ(Number, 0, 0);
    foreach (DB.Element element in Elements)
    {
      DB.ElementTransformUtils.MoveElement(Revit.ActiveDBDocument, element.Id, translation);
      //ChangeElementColor(element.Id);
    }
  }
  public void MoveLeft(List<DB.Element> Elements, double Number)
  {
    DB.XYZ translation = new DB.XYZ(-Number, 0, 0);
    foreach (DB.Element element in Elements)
    {
      DB.ElementTransformUtils.MoveElement(Revit.ActiveDBDocument, element.Id, translation);
      //ChangeElementColor(element.Id);
    }
  }
  public void MoveUp(List<DB.Element> Elements, double Number)
  {
    DB.XYZ translation = new DB.XYZ(0, Number, 0);
    foreach (DB.Element element in Elements)
    {
      DB.ElementTransformUtils.MoveElement(Revit.ActiveDBDocument, element.Id, translation);
      //ChangeElementColor(element.Id);
    }
  }

  public void MoveDown(List<DB.Element> Elements, double Number)
  {
    DB.XYZ translation = new DB.XYZ(0, -Number, 0);
    foreach (DB.Element element in Elements)
    {
      DB.ElementTransformUtils.MoveElement(Revit.ActiveDBDocument, element.Id, translation);
      //ChangeElementColor(element.Id);
    }
  }
# ---------- end c__rir_3 ----------
multiplication = Multiplication(A=c_script.number, B="1000")
multiplication_2 = Multiplication(A=Slider(0.74, range=0.1..10), B="1000")
c_script_3 = CSharpScript(beam=element_geometry, direction=c_script.direction, number=multiplication_2)  # -> out, A; inputs beam: Brep, direction: String, number: Double
# ---------- c_script_3: C# ----------
    Vector3d move = new Vector3d();
    if(direction == "right"){
      move = Vector3d.XAxis;
    }
    else if(direction == "left"){
      move = -Vector3d.XAxis;
    }
    else if(direction == "up"){
      move = Vector3d.ZAxis;
    }
    else if(direction == "down"){
      move = -Vector3d.ZAxis;
    }

    Transform trans = Transform.Translation(move * number);
    beam.Transform(trans);


    A = beam;
# ---------- end c_script_3 ----------
move = Move(Geometry=element_geometry, Motion=Vector(0, 0, 10))  # -> Geometry, Transform
panel_2 = Panel(c_script_3.A)
element_location = ElementLocation(Element=query_elements.Elements)  # -> Element, Location, Hand, Facing, WorkPlane

element_geometry_2 = ElementGeometry(Elements=query_elements.Elements)
panel_3 = Panel(element_geometry_2)
send = Send(
    Stream="https://speckle.xyz/streams/0d7a8b5152",
    Data=element_geometry_2,
    AutoSend=False,
    BaseId="c3a97b21c2ebc270e0b772f6fc8f02c0",
    CurrentComponentState="expired",
    KitName="Objects",
    OutputWrappers="https://speckle.xyz\t0d7a8b5152\te64de0c6d5",
    UseDefaultCache=True,
    selectedKitName="Objects")

panel_4 = Panel(element_location.Location)
